# Grasshopper definition Passthrough.gh (Grasshopper 1.0.8)
# plug-ins: Pufferfish, Passthrough

panel = Panel("--morph ffd")
# Base: uv run python scripts\run_roundtrip.py run "exchange\out\payload.json" "exchange\return"
panel_2 = Panel("""--morph ffd
--morph identity
--morph collision""")
# Base: uv run python scripts\run_roundtrip.py run --morph ffd
# Base: uv run python scripts\run_roundtrip.py run
# Base: uv run python scripts\run_roundtrip.py run "C:\Users\nbarnes\Documents\GitHub\passthrough\exchange\out\payload.json" "C:\Users\nbarnes\Documents\GitHub\passthrough\exchange\return"
number_slider = Slider(1, range=0..10)
concat = Concatenate()
# Base: uv run python scripts\run_roundtrip.py run "C:\Users\nbarnes\Documents\GitHub\passthrough\exchange\out\payload.json" "C:\Users\nbarnes\Documents\GitHub\passthrough\exchange\return" --morph ffd
item = ListItem(List=panel_2, Index=number_slider, Wrap=True)
base = Panel("uv run python scripts\run_roundtrip.py run ")
list = ValueList({"--morph ffd", "--morph identity", "--morph collision"}, selected="--morph identity")
concat_2 = Concatenate(FragmentA=base, FragmentB=list)

panel_3 = Panel("C:\Users\nbarnes\Documents\GitHub\passthrough\exchange\return")

# ----
# PASSTHROUGH
# EXPORT SURFACE/MESH TO JSON
panel_4 = Panel("C:\Users\nbarnes\Documents\GitHub\passthrough\exchange\out")
input_surface = Geometry(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)

concat_3 = Concatenate(FragmentA=panel_4, FragmentB="payload.json", JoinSeparator="\")

pxexport = PassthroughExport(Surface=input_surface, UCount=24, VCount=Slider(34, range=0..100), Folder=panel_4, Write=Toggle(True))  # -> Payload, Mesh
pxtrigger = PassthroughTrigger(
    Payload=concat_3,
    Return=panel_3,
    Command=concat_2,
    WorkDir="C:\Users\nbarnes\Documents\GitHub\passthrough",
    Run=Toggle(True))  # -> Launched, Return
pximport = PassthroughImport(Return=panel_3, Pull=Toggle(True))  # -> Mesh, Surface, Range, CollisionPoints, FoldedFaces, DriftMax, CurvatureMax, Status
data = Data(pximport.Mesh)
data_2 = Data(pximport.Surface)
data_3 = Data(pxexport.Mesh)
panel_5 = Panel(pxtrigger.Launched)
panel_6 = Panel(pxexport.Payload)
panel_7 = Panel(pxtrigger.Return)
panel_8 = Panel(pximport.FoldedFaces)
panel_9 = Panel(pximport.CollisionPoints)
panel_10 = Panel(pximport.DriftMax)
panel_11 = Panel(pximport.CurvatureMax)
panel_12 = Panel(pximport.Range)
panel_13 = Panel(data)
panel_14 = Panel(data_2)
panel_15 = Panel(data_3)
panel_16 = Panel(pximport.Status)
merge = Merge(Data1=input_surface, Data2=data_2)
srfstats = SurfaceStatistics(Surface=merge)  # -> FaceCount, UntrimmedFaceCount, TrimmedFaceCount, EdgeCount, VertexCount, ControlPointCount
panel_17 = Panel(srfstats.FaceCount)
panel_18 = Panel(srfstats.TrimmedFaceCount)
panel_19 = Panel(srfstats.UntrimmedFaceCount)
panel_20 = Panel(srfstats.VertexCount)
panel_21 = Panel(srfstats.ControlPointCount)
